# Dynamo graph crossSectionOPT.dyn (Dynamo 2.1.0.7500)

# group: Master Thesis Structural design
# note: CREATED BY: Juan González Cavero
# CREATED: 01-03-2019
# VERSION <0.4>
# LAST EDITED: <26-03-20>
# DYNAMO VERSION: <Dynamo 2.1.0>
# PACKAGES:
# - Sofilink (link to Sofistik)
# - Data-Shapes
# - Clockwork
# - Rhythm
# NOTES:
# Structural steel beam design for train bridges (Sofistik needed)

# group: USER INPUTS
# note: Beam family
file_path = Filename(".\SteelBeamSegmentDB.rfa")  # graph input
# note: Alignment axis
origin_Coordinate = CodeBlock { X=0; Y=0; Z=0; }
end_Coordinate = CodeBlock { X=20; Y=0; Z=0; }
# note: FEM mesh size
hmin = IntegerSlider(2, range=1..5 step 1)  # graph input
# note: Genetic Algorithm settings
number_of_generations = DoubleInput(12)  # graph input
watch = Watch(number_of_generations)
population_size = DoubleInput(12)  # graph input
watch_2 = Watch(population_size)
# note: Population:
# This will define how many combinations within the lower/upper limits will be randomly generated.
# Objectives:
# There is one objective in the optimization: finding a solution with the lowest Weight score. As the optimization is constraint, the results will be withing the allowable deformation and stress range.
# Variables (Lower / Upper limits):
# Optimo will vary the defined dimensions withing this range.
lower_limits = CodeBlock()
# ---------- lower_limits.designscript (6 lines) ----------
Beam_Height = 0.6;
Beam_Thickness = 0.01;
Lane_Width = 1.9;
Parapet_Thickness = 0.05;
Parapet_Width = 0.3;
Slab_Thickness = 0.1;
# ----------------------------------------
lower_limit_list = List.Create(item0=lower_limits.Beam_Height, item1=lower_limits.Beam_Thickness, item2=lower_limits.Lane_Width, item3=lower_limits.Parapet_Thickness, item4=lower_limits.Parapet_Width, item5=lower_limits.Slab_Thickness)
# note: IMPORTANT!!
# These must follow alphabetical order!
upper_limits = CodeBlock()
# ---------- upper_limits.designscript (6 lines) ----------
Beam_Height = 0.9;
Beam_Thickness = 0.04;
Lane_Width = 1.9;
Parapet_Thickness = 0.30;
Parapet_Width = 0.6;
Slab_Thickness = 0.1;
# ----------------------------------------
upper_limit_list = List.Create(item0=upper_limits.Beam_Height, item1=upper_limits.Beam_Thickness, item2=upper_limits.Lane_Width, item3=upper_limits.Parapet_Thickness, item4=upper_limits.Parapet_Width, item5=upper_limits.Slab_Thickness)
constraints = CodeBlock()
# ---------- constraints.designscript (8 lines) ----------
AllowableStress=275/1.1;
StressMinPenalty=20;
StressMaxPenalty=100;
MinRatio=0.8;
MaxRatio=1.0;
DisplacementPenalty=100;
MaxDisplacement=10;
//MaxDisplacement in mm
# ----------------------------------------
constraint_list = List.Create(item0=constraints.AllowableStress, item1=constraints.StressMinPenalty, item2=constraints.StressMaxPenalty, item3=constraints.MinRatio, item4=constraints.MaxRatio, item5=constraints.DisplacementPenalty, item6=constraints.MaxDisplacement)

# group: Modeling
loadFamily = Custom[Document.LoadFamily](path=file_path)  # A very crude implementation of family loading. Will *not* reload an already loaded family of the same name.
point_bycoordinates_1 = Point.ByCoordinates(x=origin_Coordinate.X, y=origin_Coordinate.Y, z=origin_Coordinate.Z)
point_bycoordinates_2 = CodeBlock(t1=end_Coordinate.X, t2=end_Coordinate.Y, t3=end_Coordinate.Z) { point1 = Point.ByCoordinates(t1, t2, t3); }
list_create = List.Create(item0=point_bycoordinates_1, item1=point_bycoordinates_2)
byPoints = NurbsCurve.ByPoints(points=list_create)
levels = Levels("Level 1")
# note: The selected beam (framing) is created along the curve for the desired level.
beamByCurve = StructuralFraming.BeamByCurve(curve=byPoints, level=levels, structuralFramingType=loadFamily.familyTypes)
point_bycoordinates_3 = CodeBlock { point1 = Point.ByCoordinates(t1, t2, t3); }  # frozen; unwired: t1, t2, t3

# group: Axis
# note: Sofistik’s axes are not the same as the ones of Revit. The orientation of axis Y is oppositely oriented.
# This group divides the resulting nurbcurve from the excel sheet into segments of a user-specified length and maps Revit axes Y to Sofistik’s axes.
divideSegments = Custom[Curve.DivideSegments](curves=byPoints, hmin=hmin)  # Divides curve into equal segments using hmin and returns points and station values.
code_block = CodeBlock()
# ---------- code_block.designscript (4 lines) ----------
point1 = Point.ByCoordinates(0, 0, 0);
vector1 = Vector.ByCoordinates(1, 0, 0);
vector2 = Vector.ByCoordinates(0, -1, 0);
coordinate1 = CoordinateSystem.ByOriginVectors(point1, vector1, vector2);
# ----------------------------------------
transform = Geometry.Transform(geometry=divideSegments.points, cs=code_block.coordinate1)

# group: INDEXING
# note: Nodes used by sofistik are returned.
indicesOfItems = Custom[List.IndicesOfItems](items=divideSegments.placements, list=divideSegments.points)  # returns indices of items' occurence in list
indices = CodeBlock(points=transform) { 0..Count(points)-1; 101..100+Count(points)-1; 1001..1000+Count(points)-1; 1002..1000+Count(points); 1; }
removeItems = Custom[List.RemoveItems](items=indicesOfItems, list=indices.out0)  # removes given items from list

# group: UNITS IN METERS!!
boolean = BoolSelector(true)
python_script = Python(IN[0]=boolean)
# ---------- python_script.python (22 lines) ----------
import clr

clr.AddReference('RevitAPI')
from Autodesk.Revit.DB import *

clr.AddReference('RevitServices')
import RevitServices
from RevitServices.Persistence import DocumentManager
from RevitServices.Transactions import TransactionManager

doc = DocumentManager.Instance.CurrentDBDocument

if IN[0]:
	TransactionManager.Instance.EnsureInTransaction(doc)
	unit = doc.GetUnits()
	format = FormatOptions(DisplayUnitType.DUT_METERS)
	unit.SetFormatOptions(UnitType.UT_Length,format)
	doc.SetUnits(unit)
	TransactionManager.Instance.TransactionTaskDone()
	OUT = "length unit changed to meter"
else:
	OUT = "Set IN[0] to true!"
# ----------------------------------------

code_block_2 = CodeBlock(a=beamByCurve) { a[0]; }

# group: Get cross section parameters
code_block_3 = CodeBlock { ".\\parametersName.txt"; }
parameters = Element.Parameters(element=code_block_2)
# note: This group retrieves family dimensional parameters in an automatic way by applying a pair of filters:
# - "PG_GEOMETRY" as group parameter.
# (PG_GEOMETRY is the name in Dynamo that corresponds to Dimension group parameter in Revit)
# - ReadOnly = false
# IMPORTANT!!
# Parameters are retrieved in alphabetical order.
group = Parameter.Group(parameter=parameters)
select_builtin_parameter_group = BuiltInParameterGroup("PG_GEOMETRY")
eq = group == select_builtin_parameter_group
code_block_4 = CodeBlock { true; }
allIndicesOf = List.AllIndicesOf(list=eq, item=code_block_4)
# note: All dimensional parameters
getItemAtIndex = List.GetItemAtIndex(list=parameters, index=allIndicesOf)
isReadOnly = Parameter.IsReadOnly(parameter=getItemAtIndex)
eq_2 = parameters == isReadOnly
code_block_5 = CodeBlock { false; }
allIndicesOf_2 = List.AllIndicesOf(list=eq_2, item=code_block_5)
# note: Dimensional parameters which ReadOnly = false
getItemAtIndex_2 = List.GetItemAtIndex(list=getItemAtIndex, index=allIndicesOf_2)
name = Parameter.Name(parameter=getItemAtIndex_2)
string_from_array = FromArray(arr=name)
code_block_6 = CodeBlock { [",","{","}"]; ["\r\n",null,null]; }
replaceMultiple = Custom[String.ReplaceMultiple](str=string_from_array, searchFor=code_block_6.out0, replaceWith=code_block_6.out1)  # Replaces multiple search terms in a given string with multiple replacements
writeText = FileSystem.WriteText(filePath=code_block_3, text=replaceMultiple)

# group: Sofistik master file
code_block_7 = CodeBlock { ".\\masterDB.dat"; }
mid_span = CodeBlock(a=end_Coordinate.X, Hmin=hmin) { 1001+a/4; Hmin; }
code_block_8 = CodeBlock(Hmin=mid_span.Hmin, stressPoint=mid_span.out0)
# ---------- code_block_8.designscript (122 lines) ----------
"
$:.:.:.:.:.:.:.:.:.:.:.:.:.:.:.:.:.:.:.:.:.:.:.:.:.:.:$
$:.:.: SOFiSTiK MODEL W/ TEEDY - DOPPEL-T BRÜCKE :.:.:$
$:.:.:.:.:.:.:.:.:.:.:.:.:.:.:.:.:.:.:.:.:.:.:.:.:.:.:$

#DEFiNE Q_LOAD = 55.0 $:.:UDL LiVE LOAD [KN/M]:.:.:.:.:.:.:.:.:.:.:.:.:$
                       $:.:GLOBAL VARiABLE, ACESSiBLE FROM ANY MODULE:.:$

+PROG AQUA URS:1
HEAD U_CROSS_SECTION, END BEAMS
NORM EN 1992-2004
UNIT 0
CTRL STYP 0
STEE 1 S 275
ECHO SECT YES

$ VARiABLES
#include SimpleAnalysis\\parameters.dat

$ CROSS SECTION
#include SimpleAnalysis\\section.dat

END

+PROG SOFiMSHC URS:11
HEAD DEFiNiTiON OF AXiS
SYST 3D GDIV 1000 GDIR POSZ
ECHO GEOM FULL
CTRL TOPO GAXP 3 $ GENERATE STRUCTURAL POiNTS & LiNES ALONG PLACEMENTS
CTRL MESH 2      $ ACTiVATE MESHiNG OF STRUCTRUAL SYSTEM iNTO BEAM ELEMENTS
CTRL HMiN "+Hmin+"    $ MESH SiZE: MAXiMUM LENGTH OF BEAM ELEMENTS

$ DEFiNiTiON OF AXiS iN PLAN ViEW <<< WE NEED TO PROViDE STATiONS__________________________________________
#include SimpleAnalysis\\axis.dat

$ Structural Grid (Strucutal points)
#include SimpleAnalysis\\structuralpoints.dat
#include SimpleAnalysis\\structuralpointsgroup.dat

$ Structual lines (only needed for double transversal cross sections)


$ POiNTS AND LiNES AT 1ST SUPPORT
$ START BEAM RiGHT SUPPORT
SPT 1100 REF PT 100 X 0 =#Lane_Width-.3 =#Parapet_Thickness+#Beam_Height+#Slab_Thickness FIX F->100
        $RiGHT SPRiNG STiFFNESS
        SPTS TYPE CXX CP 1.E+6 GRP 2
        SPTS TYPE CYY CP 1.E+6 GRP 2
        SPTS TYPE CZZ CP 1.E+6 GRP 2
$ START BEAM LEFT SUPPORT
SPT 2100 REF PT 100 X 0 =-#Lane_Width+.3 =#Parapet_Thickness+#Beam_Height+#Slab_Thickness FIX F->100
        $LEFT SPRiNG STiFFNESS
        SPTS TYPE CZZ CP 1.E+6 GRP 2

$ POiNTS AND LiNES AT 3RD SUPPORT
$ END BEAM RiGHT SUPPORT
SPT 1300 REF PT 200 X 0 =#Lane_Width-.3 =#Parapet_Thickness+#Beam_Height+#Slab_Thickness FIX F->200
        $RiGHT SPRiNG STiFFNESS
        SPTS TYPE CXX CP 1.E+6 GRP 3
        SPTS TYPE CYY CP 1.E+6 GRP 3
        SPTS TYPE CZZ CP 1.E+6 GRP 3
$ END BEAM LEFT SUPPORT
SPT 2300 REF PT 200 X 0 =-#Lane_Width+.3 =#Parapet_Thickness+#Beam_Height+#Slab_Thickness FIX F->200
        $LEFT SPRiNG STiFFNESS
        SPTS TYPE CZZ CP 1.E+6 GRP 3
END


+PROG AQUA URS:4
HEAD iNTERPOLATiON OF SECTiONS ALONG AXiS
ECHO FULL 0
INTE 0
END

+PROG SOFiLOAD URS:6
HEAD ACTiONS + LOADS

$:.:DEFiNE ACTiONS:.:$
ACT G $:.:SELF WEiGTH:.:$
ACT Q $:.:iMPOSED LOADS:.:$

$ Definition of Load cases
$:.:SELF WEiGTH:.:$     ALL
LC 1 TYPE G DLZ 1

$:.:iMPOSED LOADS:.:$   1
LC 2 TYPE Q
BEAM grp 1  TYPE PZZ PA $(Q_LOAD)

END

+PROG ASE URS:5
HEAD CALCULATE
CTRL OPT BEAM
LC 1
LC 2
END


+PROG RESULTS urs:3
HEAD Export results
$ Sheet 1 = weight per meter
XLSX NAME 'data.xlsx' WS 'W' ROW 1 COL 1 CLNM YES
DBO  NAME 'beam_fcs.sign' ND    4
TXTP SHOW SIGN OVLP AMAX
STRU TYPE GAMM ETYP SECT REPR DLST
$ Sheet 2 = max stresses
XLSX NAME 'data.xlsx' WS 'S' ROW 1 COL 1 CLNM YES
DBO  NAME 'beam_fcs.sign' ND    4
FILT NAME 'beam_fcs._pcstype' TYPE TEXT OPTI  YES VAL1 'Stressp*'
LC   NO 2
LC   ENO "+stressPoint+" X 0
TXTP SHOW SIGN OVLP AMAX
CROS TYPE SIG ETYP BEAM RTYP LINE REPR DLST
$ Sheet 3 = max deflections
XLSX NAME 'data.xlsx' WS 'D' ROW 1 COL 1 CLNM YES
FILT NAME 'n_disp.uz' TYPE EX
LC   NO 2
TXTP SHOW SIGN OVLP AMAX
NODE TYPE UZ REPR DLST
END
";
# ----------------------------------------
# note: This node creates the master teddy DAT file that drives all the other DAT files.
# This must manually be created previously in Sofistik.
# Then we place the code here to allow user customization in Dynamo.
writeText_2 = FileSystem.WriteText(filePath=code_block_7, text=code_block_8)

# group: GA parameters
code_block_9 = CodeBlock { ".\\toPython.txt"; }
join = List.Join(list0=watch, list1=watch_2, list2=lower_limit_list, list3=upper_limit_list, list4=constraint_list)
string_from_array_2 = FromArray(arr=join)
code_block_10 = CodeBlock { [",","{","}"]; ["\r\n",null,null]; }
replaceMultiple_2 = Custom[String.ReplaceMultiple](str=string_from_array_2, searchFor=code_block_10.out0, replaceWith=code_block_10.out1)
writeText_3 = FileSystem.WriteText(filePath=code_block_9, text=replaceMultiple_2)

code_block_11 = CodeBlock()
# ---------- code_block_11.designscript (6 lines) ----------
["Parapet_Thickness",
"Beam_Thickness",
"Slab_Thickness",
"Parapet_Width",
"Lane_Width",
"Beam_Height"];
# ----------------------------------------

# group: OUTPUT DATA FILES TO SOFISTIK
code_block_12 = CodeBlock { ".\\SimpleAnalysis\\section.dat"; }
code_block_13 = CodeBlock { "Sofistik Section"; }
getParameterValueByName = Element.GetParameterValueByName(element=loadFamily.familyTypes, parameterName=code_block_13)
code_block_14 = CodeBlock(a=getParameterValueByName) { "$prog aqua\nHEAD Testversion\n"+a; }
writeText_4 = FileSystem.WriteText(filePath=code_block_12, text=code_block_14)
structural_points = CodeBlock(indices=removeItems)
# ---------- structural_points.designscript (4 lines) ----------
".\\SimpleAnalysis\\structuralpointsgroup.dat";
prog = "sofimshc";
header = ["SPTP","REF","GRP"];
body = [indices + 1001, "1"];
# ----------------------------------------
writeDataToFile = Custom[DAT.WriteDataToFile](filepath=structural_points.out0, program=structural_points.prog, header=structural_points.header, body=structural_points.body)  # Given a header and a body as a list this node will generate a DAT Sofistik File
structural_lines = CodeBlock(indices=indices.out1, start=indices.out2, end=indices.out3, section=indices.out4)
# ---------- structural_lines.designscript (4 lines) ----------
".\\SimpleAnalysis\\structurallines.dat";
prog = "sofimshc";
header = ["SLN", "NO", "NPA", "NPE", "SNO"];
body = [indices, start, end, section];
# ----------------------------------------
writeDataToFile_2 = Custom[DAT.WriteDataToFile](filepath=structural_lines.out0, program=structural_lines.prog, header=structural_lines.header, body=structural_lines.body)
# note: Returns all the necessary DAT to represent the deck geometry, except the main DAT file (this is created in another group).
# Remember to #inlcude the resulting DAT files in the main.
# Sofistik is ready to run =)
getItemAtIndex_3 = List.GetItemAtIndex(list=divideSegments.points, index=removeItems)
X = Point.X(point=getItemAtIndex_3)
structural_points_2 = CodeBlock(indices=removeItems, x=X)
# ---------- structural_points_2.designscript (4 lines) ----------
".\\SimpleAnalysis\\structuralpoints.dat";
prog = "sofimshc";
header = ["SPT","NO","X","REF","NREF"];
body = [indices + 1001, x, "AX","A1"];
# ----------------------------------------
writeDataToFile_3 = Custom[DAT.WriteDataToFile](filepath=structural_points_2.out0, program=structural_points_2.prog, header=structural_points_2.header, body=structural_points_2.body)
code_block_15 = CodeBlock { "Lane"; }
getParameterValueByName_2 = Element.GetParameterValueByName(element=code_block_2, parameterName=code_block_15)
# note: Use offsets [right, -left] if the bridge contains more than one lane.
# Otherwise: use [ ];
offsets_for_secundary_axis = CodeBlock(right=getParameterValueByName_2, left=getParameterValueByName_2) { [right,-left]; []; }
writeAxisToFile = Custom[DAT.WriteAxisToFile](points=transform, stations=divideSegments.stations, placementIndices=indicesOfItems, offsets=offsets_for_secundary_axis.out1)  # writes points from spline to SOFiSTiK Axis
writeParametersToFile = Custom[DAT.WriteParametersToFile](element=code_block_2, names=code_block_11)  # Given an parameteric element and a set of parameter names it will translate these parameters with values to Sofistik variables.

# group: Create SimpleAnalysis folder
get_current_folder = Python()  # unwired: IN[0]
# ---------- get_current_folder.python (20 lines) ----------
# Importing Reference Modules
# CLR ( Common Language Runtime Module )
import clr
# Adding the DynamoRevitDS.dll module to work with the Dynamo API
clr.AddReference('DynamoRevitDS')
import Dynamo 
import os
# access to the current Dynamo instance and workspace
dynamoRevit = Dynamo.Applications.DynamoRevit()
currentWorkspace = dynamoRevit.RevitDynamoModel.CurrentWorkspace

file_path = currentWorkspace.FileName

split = file_path.split('\\')

directory_path = file_path.replace(split[-1],"")



OUT = directory_path
# ----------------------------------------
code_block_16 = CodeBlock(a=get_current_folder) { a+"\\SimpleAnalysis"; }
directory_from_path = DirectoryObject(path=code_block_16)
watch_3 = Watch(code_block_16)
