# Dynamo graph import_OptResults.dyn "readOptResults" (Dynamo 2.1.0.7500)

select_model_element = DSModelElementSelection()  # 1 picked in the model; graph input
code_block = CodeBlock()
# ---------- code_block.designscript (9 lines) ----------
["Beam_Height",
"Beam_Thickness",
"Lane_Width",
"Parapet_Thickness",
"Parapet_Width",
"Slab_Thickness",
"Weight",
"Max_Stress",
"Max_Displacement"];
# ----------------------------------------

# group: Retrieve optimized parameters
file_path = Filename(".\toDynamo.txt")
readText = FileSystem.ReadText(file=file_path)
code_block_2 = CodeBlock { "\r\n"; }
split = String.Split(str=readText, separator0=code_block_2)
toNumber = String.ToNumber(str=split)

# group: Retrieve Analysis results
file_path_2 = Filename(".\data.xlsx")
cell_ranges = CodeBlock { ["B2","I4","E3"]; }
script = Python(IN[0]=file_path_2, IN[1]=cell_ranges)  # "Python.Script"
# ---------- script.python (21 lines) ----------
import clr
clr.AddReferenceByName('Microsoft.Office.Interop.Excel, Version=11.0.0.0, Culture=neutral, PublicKeyToken=71e9bce111e9429c')
from Microsoft.Office.Interop import Excel

ex = Excel.ApplicationClass()   
ex.DisplayAlerts = False
filepath = IN[0]
workbook = ex.Workbooks.Open(filepath)

# IN[1] list with cell specification:
cell_range= IN[1]
cell_value = []
for i, ws in enumerate(workbook.Worksheets):
    cell_value.append(ws.Range[cell_range[i-1]].Value2)

close=workbook.Close(True)
close=ex.Quit

#First worksheet is null
del cell_value[0]
OUT=cell_value
# ----------------------------------------
code_block_3 = CodeBlock(t3=script) { t2 = List.Chop(t3, 3); t4 = List.Transpose(t2); }
flatten = List.Flatten(list=code_block_3.t4)

join = List.Join(list0=toNumber, list1=flatten)
setParameterByName = Element.SetParameterByName(element=select_model_element, parameterName=code_block, value=join)
