# Dynamo custom node Curve.GetParameterValuesAtStations.dyf (Dynamo 1.3.3.4111)
# category: SofiLink.Geometry
# This Node is based on the definition of a start and end parameter of the structural framing family. It returns the parameter values at the stations from a set of curves and elements.

curves = Input(curves:Curve[])
elements = Input(elements:Element[])
parameters = Input(parameters:var[])
# note: bridges the unability of the generic GetParameterValueByName node to deal with an array of elements and parameters
parameters_for_each_element = Python(IN[0]=elements, IN[1]=parameters)
# ---------- parameters_for_each_element.python (14 lines) ----------
import clr
clr.AddReference('ProtoGeometry')
from Autodesk.DesignScript.Geometry import *
#The inputs to this node will be stored as a list in the IN variables.
dataEnteringNode = IN

#Assign your output to the OUT variable.

if isinstance(IN[0],list):
	OUT = []
	[OUT.append(IN[1]) for element in IN[0]]
else:
	OUT = IN[1]		
OUT
# ----------------------------------------
getParameterValueByName = Element.GetParameterValueByName(element=elements, parameterName=parameters_for_each_element)
# note: assigns parameter values to stations
parametersAtStations = Python(IN[0]=curves, IN[1]=getParameterValueByName)  # "Curve.ParametersAtStations"
# ---------- parametersAtStations.python (22 lines) ----------
import clr
clr.AddReference('ProtoGeometry')
from Autodesk.DesignScript.Geometry import *
#The inputs to this node will be stored as a list in the IN variables.
dataEnteringNode = IN

#Assign your output to the OUT variable.
if isinstance(IN[0], list):
	oldlength = 0
	stations = []
	values = []
	for curve, endvals in zip(IN[0],IN[1]):
		stations.append(oldlength)
		stations.append(round(oldlength + curve.Length, 3))
		values.append(endvals[0])
		values.append(endvals[-1])
		oldlength = stations[-1]
	
	OUT = (stations, values)
else:
	OUT = ([0, IN[0].Length],IN[1])
	
# ----------------------------------------
code_block = CodeBlock(a=parametersAtStations) { a[0]; a[-1]; }
stations = Output(code_block.out0)
values = Output(code_block.out1)
