# Dynamo custom node DAT.ReadParameterValuesFromFile.dyf (Dynamo 1.3.3.4111)
# category: SofiLink.Core.File
# Reads from the 'parameter file' the parameter values at each station along the bridge axis 'A1'.

name = Input(name: var)
python_script = Python(IN[0]=name)
# ---------- python_script.python (8 lines) ----------
import clr
clr.AddReference('ProtoGeometry')
from Autodesk.DesignScript.Geometry import *
#The inputs to this node will be stored as a list in the IN variables.
dataEnteringNode = IN

#Assign your output to the OUT variable.
OUT = '.\\' + str(IN[0]) + '.dat'
# ----------------------------------------
readText = File.ReadText(python_script)
python_script_2 = Python(IN[0]=name, IN[1]=readText)
# ---------- python_script_2.python (17 lines) ----------
import clr
clr.AddReference('ProtoGeometry')
from Autodesk.DesignScript.Geometry import *
#The inputs to this node will be stored as a list in the IN variables.
dataEnteringNode = IN

varvals = []

for line in IN[1].split('\n'):
	if line.startswith("\tA1"):
		var = line.split('\t')
		if var[2] == str(IN[0]):
			varvals.append(float(var[-2]))

#Assign your output to the OUT variable.

OUT = varvals
# ----------------------------------------
values = Output(python_script_2)
