# Dynamo custom node FileSystem.DirectoryInWorkspace.dyf (Dynamo 2.1.0.7500)
# category: SofiLink.Core
# Creates a new folder with a given name in the current workspace (where the .dyn file is located)

get_current_folder = Python()  # unwired: IN[0]
# ---------- get_current_folder.python (19 lines) ----------
# Importing Reference Modules
# CLR ( Common Language Runtime Module )
import clr
# Adding the DynamoRevitDS.dll module to work with the Dynamo API
clr.AddReference('DynamoRevitDS')
import Dynamo 
import os
# Access current Dynamo instance and workspace
dynamoRevit = Dynamo.Applications.DynamoRevit()
currentWorkspace = dynamoRevit.RevitDynamoModel.CurrentWorkspace

file_path = currentWorkspace.FileName

split = file_path.split('\\')

directory_path = file_path.replace(split[-1],"")


OUT = directory_path
# ----------------------------------------
SubfolderName = Input(SubfolderName: string)
subfolder_path = CodeBlock(CurrentFolderPath=get_current_folder, SubfolderName=SubfolderName) { CurrentFolderPath + SubfolderName; }
directory_from_path = DirectoryObject(path=subfolder_path)
directory = Output(directory_from_path)
