# Dynamo custom node FileSystem.GetCurrentWorkspace.dyf (Dynamo 2.1.0.7500)
# category: SofiLink.Core
# Retrieves the current worspace directory (where the .dyn file is located) and returns its path as a string.

get_current_folder = Python()  # unwired: IN[0]
# ---------- get_current_folder.python (19 lines) ----------
# Importing Reference Modules
# CLR ( Common Language Runtime Module )
import clr
# Adding the DynamoRevitDS.dll module to work with the Dynamo API
clr.AddReference('DynamoRevitDS')
import Dynamo 
import os
# Access current Dynamo instance and workspace
dynamoRevit = Dynamo.Applications.DynamoRevit()
currentWorkspace = dynamoRevit.RevitDynamoModel.CurrentWorkspace

file_path = currentWorkspace.FileName

split = file_path.split('\\')

directory_path = file_path.replace(split[-1],"")


OUT = directory_path
# ----------------------------------------
OUT = Output(get_current_folder)
