# Dynamo custom node List.IndicesOfItems.dyf (Dynamo 1.3.3.4111)
# category: SofiLink.Core
# returns indices of items' occurence in list

items = Input(items:var[])
list = Input(list:var[])
indices = Python(IN[0]=items, IN[1]=list)  # "List.Indices"
# ---------- indices.python (14 lines) ----------
import clr
clr.AddReference('ProtoGeometry')
from Autodesk.DesignScript.Geometry import *
#The inputs to this node will be stored as a list in the IN variables.
dataEnteringNode = IN

#Assign your output to the OUT variable.
indices = []
for item in IN[0]:
	for i, litem in enumerate(IN[1]):
		if item == litem: #(placement.X == point.X and placement.Y == point.Y and placement.Z == point.Z):
			indices.append(i)
			
OUT = indices
# ----------------------------------------
indices_2 = Output(indices)  # "indices"
