# Dynamo custom node Parameter.DimensionalInstanceName.dyf (Dynamo 2.1.0.7500)
# category: SofiLink.Element
# Retrieves dimensional instance parameter names from a Revit family in alphabetical order

element = Input(element: Revit.Elements.Element)
parameters = Element.Parameters(element=element)
# note: This Node retrieves family dimensional parameters by applying a pair of filters:
# - "PG_GEOMETRY" as group parameter.
# (PG_GEOMETRY is the name in Dynamo that corresponds to Dimension group parameter in Revit)
# - ReadOnly = false
# IMPORTANT!!
# Parameters are retrieved in alphabetical order.
group = Parameter.Group(parameter=parameters)
select_builtin_parameter_group = BuiltInParameterGroup("PG_GEOMETRY")
eq = group == select_builtin_parameter_group
code_block = CodeBlock { true; }
allIndicesOf = List.AllIndicesOf(list=eq, item=code_block)
# note: All dimensional parameters
getItemAtIndex = List.GetItemAtIndex(list=parameters, index=allIndicesOf)
isReadOnly = Parameter.IsReadOnly(parameter=getItemAtIndex)
eq_2 = parameters == isReadOnly
code_block_2 = CodeBlock { false; }
allIndicesOf_2 = List.AllIndicesOf(list=eq_2, item=code_block_2)
# note: Dimensional parameters which ReadOnly = false
# (Instance parameters)
getItemAtIndex_2 = List.GetItemAtIndex(list=getItemAtIndex, index=allIndicesOf_2)
name = Parameter.Name(parameter=getItemAtIndex_2)
Parameters_Name = Output(name)  # "Parameters.Name"
