# Dynamo graph import_results.dyn "readResults" (Dynamo 2.1.0.7500)

select_model_element = DSModelElementSelection()  # 1 picked in the model; graph input
analysis_results_parameters = CodeBlock { ["Weight","Max_Stress","Max_Displacement","Analysis_Report"]; }

# group: Retrieve analysis results
file_path = Filename(".\data.xlsx")
cell_ranges = CodeBlock { ["B2","I4","E3"]; }
script = Python(IN[0]=file_path, IN[1]=cell_ranges)  # "Python.Script"
# ---------- script.python (21 lines) ----------
import clr
clr.AddReferenceByName('Microsoft.Office.Interop.Excel, Version=11.0.0.0, Culture=neutral, PublicKeyToken=71e9bce111e9429c')
from Microsoft.Office.Interop import Excel

ex = Excel.ApplicationClass()   
ex.DisplayAlerts = False
filepath = IN[0]
workbook = ex.Workbooks.Open(filepath)

# IN[1] list with cell specification:
cell_range= IN[1]
cell_value = []
for i, ws in enumerate(workbook.Worksheets):
    cell_value.append(ws.Range[cell_range[i-1]].Value2)

close=workbook.Close(True)
close=ex.Quit

#First worksheet is null
del cell_value[0]
OUT=cell_value
# ----------------------------------------
code_block = CodeBlock(t3=script) { t2 = List.Chop(t3, 3); t4 = List.Transpose(t2); }
file_path_2 = Filename(".\master_file.plb")
join = List.Join(list0=code_block.t4, list1=file_path_2)
flatten = List.Flatten(list=join)

setParameterByName = Element.SetParameterByName(element=select_model_element, parameterName=analysis_results_parameters, value=flatten)
