# Dynamo custom node DAT.ReadParametersFromFile.dyf (Dynamo 1.3.3.4111)
# category: SofiLink.Core.File.DAT
# Reads from 'parameters.dat' all defined parameter names and values.

code_block = CodeBlock { ".\\parameters.dat"; }
readText = File.ReadText(code_block)
python_script = Python(IN[0]=readText)
# ---------- python_script.python (18 lines) ----------
import clr
clr.AddReference('ProtoGeometry')
from Autodesk.DesignScript.Geometry import *
#The inputs to this node will be stored as a list in the IN variables.
dataEnteringNode = IN

varnames = []
varvals = []

for line in IN[0].split('\n'):
	if line.startswith("Let#") or line.startswith("LET#"):
		var = line.split('#')
		varnames.append(var[-1].split(' ')[0])
		varvals.append(float(var[-1].split(' ')[-1]))

#Assign your output to the OUT variable.

OUT = (varnames, varvals)
# ----------------------------------------
code_block_2 = CodeBlock(a=python_script) { a[0]; }
names = Output(code_block_2)
code_block_3 = CodeBlock(a=python_script) { a[-1]; }
values = Output(code_block_3)
