# Dynamo custom node DAT.WriteAxisToFileOPT.dyf (Dynamo 2.1.0.7500)
# category: SofiLink.Core.File.DAT
# writes points from spline to SOFiSTiK Axis

code_block = CodeBlock { ".\\SimpleAnalysis\\axis.dat"; }
code_block_2 = CodeBlock()
# ---------- code_block_2.designscript (6 lines) ----------
"$prog sofimshc";
"HEAD Testversion";
"GAX A1 TYPE LANE TITL CentralAxis";
"GAXC	S	X	Y	Z";
"\n";
"GAXP	ID	S	TYPE	SPT	NCS	GRP";
# ----------------------------------------
create = List.Create(item0=code_block_2.out0, item1=code_block_2.out1, item2=code_block_2.out2, item3=code_block_2.out3)
stations = Input(stations: var[])
points = Input(points: Autodesk.DesignScript.Geometry.Point[])
pointsToString = Python(IN[0]=stations, IN[1]=points)  # "Point.PointsToString"
# ---------- pointsToString.python (8 lines) ----------
import clr
clr.AddReference('ProtoGeometry')
from Autodesk.DesignScript.Geometry import *
#The inputs to this node will be stored as a list in the IN variables.
dataEnteringNode = IN

#Assign your output to the OUT variable.
OUT = ['\t' + str(station) + '\t' + str(point.X) + '\t' + str(point.Y) + '\t' + str(point.Z) for station, point in zip(IN[0],IN[1])]
# ----------------------------------------
create_2 = List.Create(item0=code_block_2.out4, item1=code_block_2.out5)
placementIndices = Input(placementIndices: int[])
toString = Python(IN[0]=stations, IN[1]=placementIndices)  # "Placements.ToString"
# ---------- toString.python (20 lines) ----------
import clr
clr.AddReference('ProtoGeometry')
from Autodesk.DesignScript.Geometry import *
#The inputs to this node will be stored as a list in the IN variables.
dataEnteringNode = IN

#Assign your output to the OUT variable.
strings = []

for index, i in enumerate(IN[1]):
	line = []
	line.append('A1')
	line.append(str(IN[0][i]))
	line.append('J')
	line.append(str((index+1)*100))
	line.append(str(1))
	line.append(str(1))
	strings.append('\t' + '\t'.join(line))

OUT = strings
# ----------------------------------------
offsets = Input(offsets: var[])
# note: If offsets are supplied, secondary axes according to the offset values are generated
offsetToSecondaryAxis = Python(IN[0]=offsets, IN[1]=placementIndices, IN[2]=stations)
# ---------- offsetToSecondaryAxis.python (32 lines) ----------
import clr

clr.AddReference('ProtoGeometry')
from Autodesk.DesignScript.Geometry import *
#The inputs to this node will be stored as a list in the IN variables.
dataEnteringNode = IN

#Assign your output to the OUT variable.
OUT = ["\n"]

if len(IN[0]) > 0: 
	
	# create secondary axis
	for i, offset in  enumerate(IN[0]):
		OUT.append("GAXS A1 IDS " + chr(65+i) + " Y " + str(offset).replace(",",".") + " SPT +" + str((i+1)*1000) + " GRP +" + str(i+1))
		
	# create secondary axis placements and section
	OUT.append("\n")
	OUT.append("GAXP	ID	IDS	S	TYPE	NCS")
	
	for i in range(len(IN[0])):
		for j in IN[1]:
			line = []
			line.append('A1')
			line.append(chr(65 + i))
			line.append(str(IN[2][j]))
			line.append('J')
			line.append(str(1 + i))
				
			OUT.append('\t' + '\t'.join(line))

OUT
# ----------------------------------------
join = List.Join(list0=create, list1=pointsToString, list2=create_2, list3=toString, list4=offsetToSecondaryAxis)
exportCSV = Data.ExportCSV(filePath=code_block, data=join)
str = Output(join)
