# Dynamo custom node DAT.WriteParametersToFile.dyf (Dynamo 2.1.0.7500)
# category: SofiLink.Core.File.DAT
# Given an parameteric element and a set of parameter names it will translate these parameters with values to Sofistik variables.

code_block = CodeBlock { ".\\parameters.dat"; }
code_block_2 = CodeBlock { "$prog aqua"; "HEAD Parameters"; }
create = List.Create(item0=code_block_2.out0, item1=code_block_2.out1)
names = Input(names: var[])
element = Input(element: var[])
getParametersValueByName = Python(IN[0]=element, IN[1]=names)  # "Element.GetParametersValueByName"
# ---------- getParametersValueByName.python (14 lines) ----------
import clr
clr.AddReference('ProtoGeometry')
from Autodesk.DesignScript.Geometry import *
#The inputs to this node will be stored as a list in the IN variables.
dataEnteringNode = IN

elements=IN[0]
parameter_names=IN[1]

OUT = []
for i,element in enumerate(elements):
	OUT.append(element.GetParameterValueByName(parameter_names[i]))
	
OUT
# ----------------------------------------
parameter2string = Python(IN[0]=names, IN[1]=getParametersValueByName)
# ---------- parameter2string.python (8 lines) ----------
import clr
clr.AddReference('ProtoGeometry')
from Autodesk.DesignScript.Geometry import *
#The inputs to this node will be stored as a list in the IN variables.
dataEnteringNode = IN

#Assign your output to the OUT variable.
OUT = ['STO#' + parameter + ' ' + str(value)  for parameter, value in zip(IN[0], IN[1])]
# ----------------------------------------
join = List.Join(list0=create, list1=parameter2string)
exportCSV = Data.ExportCSV(filePath=code_block, data=join)
str = Output(join)
