# Dynamo custom node Point.DivideSegments.dyf (Dynamo 1.3.3.4111)
# category: SofiLink.Geometry.Point
# Returns nodes from nurbsspline according to suplied segment length

segments = Input(segments:Point[][])
points = NurbsCurve.ByPoints(segments)
hmin = Input(hmin:double = 1.0)
# note: returns an array of procentual values based on the provided hmin value
divideSegments = Python(IN[0]=segments, IN[1]=hmin)  # "Point.DivideSegments"
# ---------- divideSegments.python (15 lines) ----------
import clr
clr.AddReference('ProtoGeometry')
from Autodesk.DesignScript.Geometry import *
#The inputs to this node will be stored as a list in the IN variables.
dataEnteringNode = IN

#Assign your output to the OUT variable.
lengths = [a[-1].X-a[0].X for a in IN[0]]
hmin = IN[1]
divisions = [round(length/hmin) for length in lengths]
for i, division in enumerate(divisions):
	if division == 0:
		divisions[i] = 1

OUT = divisions
# ----------------------------------------
pointsAtEqualSegmentLength = Curve.PointsAtEqualSegmentLength(curve=points, divisions=divideSegments)
addStartAndEndPoint = Python(IN[0]=pointsAtEqualSegmentLength, IN[1]=segments)  # "Segments.AddStartAndEndPoint"
# ---------- addStartAndEndPoint.python (13 lines) ----------
import clr
clr.AddReference('ProtoGeometry')
from Autodesk.DesignScript.Geometry import *
#The inputs to this node will be stored as a list in the IN variables.
dataEnteringNode = IN

#Assign your output to the OUT variable.
divisions = []
for segment, ends in zip(IN[0],IN[1]):
	ends.pop(1)
	divisions.append([ends[0]] + segment + [ends[-1]])
	
OUT = divisions
# ----------------------------------------
flatten = Flatten(addStartAndEndPoint)
uniqueItems = List.UniqueItems(flatten)
points_2 = Output(uniqueItems)  # "points"
# note: similar to the succeeding node it returns the parameters of the curve
parameters = Python(IN[0]=divideSegments)
# ---------- parameters.python (19 lines) ----------
import clr
clr.AddReference('ProtoGeometry')
from Autodesk.DesignScript.Geometry import *
#The inputs to this node will be stored as a list in the IN variables.
dataEnteringNode = IN

#Assign your output to the OUT variable.
OUT = []

for length in IN[0]:
	parameters = []
	if length >1:
		for parameter in range(int(length)+1):
			parameters.append(parameter/(length))
	else:
		parameters = [0, 1]
	OUT.append(parameters)

OUT
# ----------------------------------------
segmentLengthAtParameter = Curve.SegmentLengthAtParameter(points, parameters)
# note: converts the segment length array to station values
# note: adds the start and end point to the array of points
stations = Python(IN[0]=segmentLengthAtParameter)
# ---------- stations.python (14 lines) ----------
import clr
clr.AddReference('ProtoGeometry')
from Autodesk.DesignScript.Geometry import *
#The inputs to this node will be stored as a list in the IN variables.
dataEnteringNode = IN

#Assign your output to the OUT variable.
val = 0
OUT = []
for segment in IN[0]:
	stations = [val + station for station in segment]
	val += segment[-1]
	OUT.append(stations)
OUT
# ----------------------------------------
flatten_2 = Flatten(stations)
uniqueItems_2 = List.UniqueItems(flatten_2)
stations_2 = Output(uniqueItems_2)  # "stations"
