# Dynamo custom node Point.SegmentsToPlacements.dyf (Dynamo 1.3.3.4111)
# category: SofiLink.Geometry.Point
# returns Placement points from given segments

segments = Input(segments:Point[][])
placements = Python(IN[0]=segments)  # "Points.Placements"
# ---------- placements.python (17 lines) ----------
import clr
clr.AddReference('ProtoGeometry')
from Autodesk.DesignScript.Geometry import *
#The inputs to this node will be stored as a list in the IN variables.
dataEnteringNode = IN

#Assign your output to the OUT variable.
i = 0
placements = []

for list in IN[0]:
	placements.append(list[0])

placements.append(IN[0][-1][-1])


OUT = placements
# ----------------------------------------
placements_2 = Output(placements)  # "placements"
