# Dynamo custom node Point.ToSegments.dyf (Dynamo 1.3.3.4111)
# category: SofiLink.Geometry.Point
# Seperates list of section positions into segement lists

points = Input(points:Point[])
toSegments = Python(IN[0]=points)  # "Point.ToSegments"
# ---------- toSegments.python (26 lines) ----------
import clr
clr.AddReference('ProtoGeometry')
from Autodesk.DesignScript.Geometry import *
#The inputs to this node will be stored as a list in the IN variables.
dataEnteringNode = IN

#Assign your output to the OUT variable.
segments = []
sub = []

for i in range(len(IN[0])-1):
	if (abs(IN[0][i].X - IN[0][i+1].X) < 1e-2 and
		abs(IN[0][i].Y - IN[0][i+1].Y) < 1e-2 and
		abs(IN[0][i].Z - IN[0][i+1].Z) < 1e-2):
		
		sub.append(IN[0][i])
		segments.append(sub)
		sub = []
		
	else:
		sub.append(IN[0][i])
		
sub.append(IN[0][-1])
segments.append(sub)

OUT = segments
# ----------------------------------------
segments = Output(toSegments)
