# Dynamo graph SofiLinkBridge.dyn (Dynamo 1.3.3.4111)

# group: EXAMPLE AXIS
code_block = CodeBlock { {0,20,30,50}; {0,2,2,0}; {14,14,14,14}; }
byCoordinates = Point.ByCoordinates(x=code_block.out0, y=code_block.out1, z=code_block.out2)
byPoints = NurbsCurve.ByPoints(byCoordinates)
splitByPoints = Curve.SplitByPoints(curve=byPoints, points=byCoordinates)

sofistik_input = BoolSelector(false)

# group: SOFISTIK INPUT
readParametersFromFile = Custom[DAT.ReadParametersFromFile]()  # Reads from 'parameters.dat' all defined parameter names and values.
code_block_2 = CodeBlock { "Beam_Height"; }
readParameterValuesFromFile = Custom[DAT.ReadParameterValuesFromFile](name=code_block_2)  # Reads from the 'parameter file' the parameter values at each station along the bridge axis 'A1'.
code_block_3 = CodeBlock(a=readParametersFromFile.values, b=readParameterValuesFromFile) { a[0..Count(a)-4]; b[0..1]; b[2..3]; b[-2..-1]; }
join = List.Join(code_block_3.out0, code_block_3.out1)
join_2 = List.Join(code_block_3.out0, code_block_3.out2)
join_3 = List.Join(code_block_3.out0, code_block_3.out3)
projectUnits = Custom[Revit.ProjectUnits]()  # Set project units to meter.

# group: CREATE DECK AND SET PARAMETERS
levels = Levels("Level 1")
family_types = FamilyTypes("DoubleTBeamSegment:DoubleTBeamSegment")
beamByCurve = StructuralFraming.BeamByCurve(curve=splitByPoints, level=levels, structuralFramingType=family_types)
code_block_4 = CodeBlock()
# ---------- code_block_4.designscript (4 lines) ----------
{"Lane", "Slab_Height", "Parapet", "Parapet_Height", "Beam_Width", "Beam_Height_Start", "Beam_Height_End"};
{2.75, 0.2, 2.75, 0.15, 1.0, 1.0, 1.5};
{2.75, 0.2, 2.75, 0.15, 1.0, 1.5, 1.5};
{2.75, 0.2, 2.75, 0.15, 1.0, 1.5, 1.0};
# ----------------------------------------
create = List.Create(code_block_4.out0, code_block_4.out0, code_block_4.out0)
create_2 = List.Create(join, join_2, join_3)
create_3 = List.Create(code_block_4.out1, code_block_4.out2, code_block_4.out3)
sofistik_or_default_input = If(test=sofistik_input, true=create_2, false=create_3)  # "Sofistik or default input parameters"
setParameterByName = Element.SetParameterByName(element=beamByCurve, parameterName=create, value=sofistik_or_default_input)
code_block_5 = CodeBlock(a=setParameterByName) { a[0][0]; }

hmin = IntegerSlider(2, range=1..5 step 1)

# group: AXIS
divideSegments = Custom[Curve.DivideSegments](curves=splitByPoints, hmin=hmin)  # Divides curve into equal segments using hmin and returns points and station values.
code_block_6 = CodeBlock { 0; 1; -1; }
byCoordinates_2 = Point.ByCoordinates(x=code_block_6.out0, y=code_block_6.out0, z=code_block_6.out0)
byCoordinates_3 = Vector.ByCoordinates(x=code_block_6.out1, y=code_block_6.out0, z=code_block_6.out0)
byCoordinates_4 = Vector.ByCoordinates(x=code_block_6.out0, y=code_block_6.out2, z=code_block_6.out0)
byOriginVectors = CoordinateSystem.ByOriginVectors(origin=byCoordinates_2, xAxis=byCoordinates_3, yAxis=byCoordinates_4)
transform = Geometry.Transform(divideSegments.points, byOriginVectors)

# group: INDEXING
indicesOfItems = Custom[List.IndicesOfItems](items=divideSegments.placements, list=divideSegments.points)  # returns indices of items' occurence in list
indices = CodeBlock(points=transform) { 0..Count(points)-1; 101..100+Count(points); 1001..1000+Count(points); 2001..2000+Count(points); 10; }
removeItems = Custom[List.RemoveItems](items=indicesOfItems, list=indices.out0)  # removes given items from list

# group: OUTPUT
code_block_7 = CodeBlock()
# ---------- code_block_7.designscript (8 lines) ----------
{"Lane",
"Slab_Height",
"Parapet",
"Parapet_Height",
"Beam_Width",
"Beam_Height_Start",
"Beam_Height_End",
"Beam_Height"};
# ----------------------------------------
writeParametersToFile = Custom[DAT.WriteParametersToFile](element=code_block_5, names=code_block_7)  # Given an parameteric element and a set of parameter names it will translate these parameters with values to Sofistik variables.
code_block_8 = CodeBlock { "Lane"; }
getParameterValueByName = Element.GetParameterValueByName(element=code_block_5, parameterName=code_block_8)
code_block_9 = CodeBlock(right=getParameterValueByName, left=getParameterValueByName) { {right,-left}; }
writeAxisToFile = Custom[DAT.WriteAxisToFile](points=transform, stations=divideSegments.stations, placementIndices=indicesOfItems, offsets=code_block_9)  # writes points from spline to SOFiSTiK Axis
code_block_10 = CodeBlock { ".\\sections.dat"; }
get_family_parameter = FamilyInstanceParameters("Sofistik Section Left(Type)(string)", family_types)
getParameterValueByName_2 = Element.GetParameterValueByName(element=family_types, parameterName=get_family_parameter)
get_family_parameter_2 = FamilyInstanceParameters("Sofistik Section Right(Type)(string)", family_types)
getParameterValueByName_3 = Element.GetParameterValueByName(element=family_types, parameterName=get_family_parameter_2)
code_block_11 = CodeBlock(a=getParameterValueByName_2, b=getParameterValueByName_3) { "$prog aqua\nHEAD Testversion\n"+a+"\n\n"+b; }
writeText = File.WriteText(code_block_10, code_block_11)
getItemAtIndex = List.GetItemAtIndex(list=divideSegments.points, index=removeItems)
X = Point.X(getItemAtIndex)
structural_points = CodeBlock(indices=removeItems, x=X, offset=getParameterValueByName)
# ---------- structural_points.designscript (4 lines) ----------
".\\structuralpoints.dat";
prog = "sofimshc";
header = {"SPT","NO","X","REF","NREF","SY"};
body = {indices + 1001, x, "AX","A1",offset};
# ----------------------------------------
writeDataToFile = Custom[DAT.WriteDataToFile](filepath=structural_points.out0, program=structural_points.prog, header=structural_points.header, body=structural_points.body)  # Given a header and a body as a list this node will generate a DAT Sofistik File
structural_lines = CodeBlock(indices=indices.out1, start=indices.out2, end=indices.out3, section=indices.out4)
# ---------- structural_lines.designscript (4 lines) ----------
".\\structurallines.dat";
prog = "sofimshc";
header = {"SLN", "NO", "NPA", "NPE", "SNO", "STYP"};
body = {indices, start, end,section,"B"};
# ----------------------------------------
writeDataToFile_2 = Custom[DAT.WriteDataToFile](filepath=structural_lines.out0, program=structural_lines.prog, header=structural_lines.header, body=structural_lines.body)
code_block_12 = CodeBlock { "Beam_Height"; }
get_modified_bridge_segments = CodeBlock(a=setParameterByName) { {a[0][0], a[1][0], a[2][0]}; }
code_block_13 = CodeBlock { {"Beam_Height_Start","Beam_Height_End"}; }
getParameterValuesAtStations = Custom[Curve.GetParameterValuesAtStations](elements=get_modified_bridge_segments, curves=splitByPoints, parameters=code_block_13)  # This Node is based on the definition of a start and end parameter of the structural framing family. It returns the parameter values at the stations from a set of curves and elements.
parameter_values_at_stations = CodeBlock(name=code_block_12, stations=getParameterValuesAtStations.stations, values=getParameterValuesAtStations.values)
# ---------- parameter_values_at_stations.designscript (4 lines) ----------
".\\"+name+".dat";
prog = "sofimshc";
header = {"GAXV","ID","NAME","S","V","TYPE"};
body = {"A1", name, stations, values,"-"};
# ----------------------------------------
writeDataToFile_3 = Custom[DAT.WriteDataToFile](filepath=parameter_values_at_stations.out0, program=parameter_values_at_stations.prog, header=parameter_values_at_stations.header, body=parameter_values_at_stations.body)
structural_points_2 = CodeBlock(indices=removeItems, x=X, offset=getParameterValueByName)
# ---------- structural_points_2.designscript (4 lines) ----------
".\\structuralpoints2.dat";
prog = "sofimshc";
header = {"SPT","NO","X","REF","NREF","SY"};
body = {indices + 2001, x, "AX","A1",-offset};
# ----------------------------------------
writeDataToFile_4 = Custom[DAT.WriteDataToFile](filepath=structural_points_2.out0, program=structural_points_2.prog, header=structural_points_2.header, body=structural_points_2.body)
