# Dynamo graph ui_premodeling.dyn (Dynamo 2.1.0.7500)

# group: Master Thesis Linking BIM-FEM
# note: CREATED BY: Juan González Cavero
# CREATED: 20-10-2019
# VERSION <v5>
# LAST EDITED: <25-03-20>
# DYNAMO VERSION: <Dynamo 2.1.0>
# PACKAGES:
# - Sofilink (link to Sofistik)
# - Data-Shapes
# - Clockwork
# - Rhythm
# NOTES:
# Steel beam design and analysis for railway bridges (Sofistik needed for FEA)

# group: INPUTS FORM
code_block = CodeBlock { "DB E&C | Slab pre-dimmensioning"; }
file_path = Filename(".\logoDYN.png")
file_from_path = FileObject(path=file_path)
readFromFile = Image.ReadFromFile(file=file_from_path)
code_block_2 = CodeBlock { "OK"; }
code_block_3 = CodeBlock { "Cross section"; }
file_path_2 = Filename(".\profileSketch.PNG")
ui_image_data = Custom[UI.Image Data](ImageTitle=code_block_3, Image=file_path_2)  # Places an image on UI.MultipleInutForm ++ .
code_block_4 = CodeBlock { "Span lenght"; 10; 24; 18; 2; }
slider = Custom[UI.Slider](InputName=code_block_4.out0, Minimum=code_block_4.out1, Maximum=code_block_4.out2, Default_Value=code_block_4.out3, Step=code_block_4.out4)  # Creates slider input for UI.MultipleInputForm ++ . Set the step to decimal value if you want a double slider, or to a integer value if you want an integer slider.
string = StringInput("Cross section")
file_path_3 = Filename(".\SteelBeamSegmentDB.rfa")
string_2 = StringInput("(Default) SteelBeamSegmentDB.rfa")
ui_filepath_data = Custom[UI.FilePath Data](InputName=string, DefaulPath=file_path_3, ButtonText=string_2)  # Create filepath input for UI.MultipleInputForm ++ . Check out www.data-shapes.net for more infos !
parameter_names_alphabetical = CodeBlock()  # "Parameter names (alphabetical order!)"
# ---------- parameter_names_alphabetical.designscript (6 lines) ----------
["Beam Height [m]",
"Beam Thickness [m]",
"Lane Width [m]",
"Parapet Thickness [m]",
"Parapet Width [m]",
"Slab Thickness[m]"];
# ----------------------------------------
code_block_5 = CodeBlock { ["0.8","0.04","1.5","0.07","0.4","0.10"]; [true, true, true, true, true, true]; }
ui_textbox_data = Custom[UI.TextBox Data](InputName=parameter_names_alphabetical, DefaultText=code_block_5.out0, IsNumberEntry=code_block_5.out1)  # Create Data for TextBox input in UI.MultipleInputForm ++ . Check out www.data-shapes.net for more informations
code_block_6 = CodeBlock { "Imposed load G [kN]"; "50"; "[kN]"; }
ui_textbox_data_2 = Custom[UI.TextBox Data](InputName=code_block_6.out0, DefaultText=code_block_6.out1, IsNumberEntry=code_block_6.out2)
code_block_7 = CodeBlock { "FEM mesh size"; 1; 5; 2; 1; }
slider_2 = Custom[UI.Slider](InputName=code_block_7.out0, Minimum=code_block_7.out1, Maximum=code_block_7.out2, Default_Value=code_block_7.out3, Step=code_block_7.out4)
boolean = BoolSelector(true)
code_block_8 = CodeBlock { "juan.gonzalez.cavero@uni-weimar.de"; }
code_block_9 = CodeBlock { "Cancel"; }
code_block_10 = CodeBlock { 900; }
code_block_11 = CodeBlock { 700; }

join = List.Join(list0=ui_image_data, list1=slider, list2=ui_filepath_data, list3=ui_textbox_data, list4=ui_textbox_data_2, list5=slider_2)

# group (continued): INPUTS FORM
ui_multipleinputform = Custom[UI.MultipleInputForm ++](Description_optional=code_block, Logo_optional=readFromFile, ButtonText_optional=code_block_2, Inputs=join, Toggle=boolean, LinkToHelp_optional=code_block_8, CancelButtonText_optional=code_block_9, MaxHeight_optional=code_block_10, Width_optional=code_block_11)  # Create a form with multiple inputs. see www.data-shapes.net for tutorials and infos!
watch = Watch(ui_multipleinputform.User_Inputs)

# group: MODEL BEAM FROM IMPUTS
code_block_12 = CodeBlock { 0; 1; 2; 8; 9; 10; 11; }
slice = List.Slice(list=watch, start=code_block_12.out6)  # unwired: end
slice_2 = List.Slice(list=watch, start=code_block_12.out5, end=code_block_12.out6)
basePoint = Coordinates.BasePoint()
slice_3 = List.Slice(list=watch, start=code_block_12.out0, end=code_block_12.out1)
watch_2 = Watch(slice_3)
byCoordinates = Point.ByCoordinates(x=watch_2)
list_create = List.Create(item0=basePoint, item1=byCoordinates)
flatten = List.Flatten(list=list_create)
byPoints = NurbsCurve.ByPoints(points=flatten)
levels = Levels("Level 1")
slice_4 = List.Slice(list=watch, start=code_block_12.out1, end=code_block_12.out2)
deconstruct = List.Deconstruct(list=slice_4)
watch_3 = Watch(deconstruct.first)
loadFamily = Custom[Document.LoadFamily](path=watch_3)  # A very crude implementation of family loading. Will *not* reload an already loaded family of the same name.
beamByCurve = StructuralFraming.BeamByCurve(curve=byPoints, level=levels, structuralFramingType=loadFamily.familyTypes)
code_block_13 = CodeBlock(a=beamByCurve) { a[0]; }
start = Revit.Transaction.Transaction.Start(input=code_block_13)
select_builtin_parameter_group = BuiltInParameterGroup("PG_GEOMETRY")
# note: This node retrieves family dimensional parameters in an automatic way by applying a pair of filters:
# - "PG_GEOMETRY" as group parameter.
# (PG_GEOMETRY is the name in Dynamo that corresponds to Dimension group parameter in Revit)
# - ReadOnly = false
# IMPORTANT!!
# Parameters are retrieved in alphabetical order.
dimensional_family_parameters = CodeBlock(t3=code_block_13, t6=select_builtin_parameter_group)  # "Dimensional family parameters RETRIEVER"
# ---------- dimensional_family_parameters.designscript (10 lines) ----------
parameter1 = Elements.Element.Parameters(t3);
t4 = Parameter.Group(parameter1);
t5 = t4 == t6;
t7 = List.AllIndicesOf(t5, true);
t8 = List.GetItemAtIndex(parameter1, t7);
t9 = Parameter.IsReadOnly(t8);
t10 = parameter1 == t9;
t11 = List.AllIndicesOf(t10, false);
t12 = List.GetItemAtIndex(t8, t11);
t13 = Parameter.Name(t12);
# ----------------------------------------
slice_5 = List.Slice(list=watch, start=code_block_12.out2, end=code_block_12.out3)
watch_4 = Watch(slice_5)
setParameterByName = Element.SetParameterByName(element=start, parameterName=dimensional_family_parameters.t13, value=watch_4)
end = Revit.Transaction.Transaction.End(input=setParameterByName)
watch_5 = Watch(byPoints)
slice_6 = List.Slice(list=watch, start=code_block_12.out4, end=code_block_12.out5)
deconstruct_2 = List.Deconstruct(list=slice_6)
watch_6 = Watch(deconstruct_2.first)
slice_7 = List.Slice(list=watch, start=code_block_12.out3, end=code_block_12.out4)
deconstruct_3 = List.Deconstruct(list=slice_7)
deconstruct_4 = List.Deconstruct(list=deconstruct_3.first)
watch_7 = Watch(deconstruct_4.first)

# group: AXIS
divideSegments = Custom[Curve.DivideSegments](curves=watch_5, hmin=watch_6)  # Divides curve into equal segments using hmin and returns points and station values.
# note: Sofistik’s axes are not the same as the ones of Revit. The orientation of axis Y is oppositely oriented.
# This group divides the resulting nurbcurve from the excel sheet into segments of a user-specified length and maps Revit axes Y to Sofistik’s axes.
code_block_14 = CodeBlock()
# ---------- code_block_14.designscript (4 lines) ----------
point1 = Point.ByCoordinates(0, 0, 0);
vector1 = Vector.ByCoordinates(1, 0, 0);
vector2 = Vector.ByCoordinates(0, -1, 0);
coordinate1 = CoordinateSystem.ByOriginVectors(point1, vector1, vector2);
# ----------------------------------------
transform = Geometry.Transform(geometry=divideSegments.points, cs=code_block_14.coordinate1)

# group: INDEXING
# note: Segments are indexed
indicesOfItems = Custom[List.IndicesOfItems](items=divideSegments.placements, list=divideSegments.points)  # returns indices of items' occurence in list
indices = CodeBlock(points=transform) { 0..Count(points)-1; 101..100+Count(points)-1; 1001..1000+Count(points)-1; 1002..1000+Count(points); 1; }
removeItems = Custom[List.RemoveItems](items=indicesOfItems, list=indices.out0)  # removes given items from list

# group: OUTPUT DATA FILES TO SOFISTIK
writeParametersToFile = Custom[DAT.WriteParametersToFile](element=end, names=dimensional_family_parameters.t13)  # Given an parameteric element and a set of parameter names it will translate these parameters with values to Sofistik variables.
code_block_15 = CodeBlock { ".\\section.dat"; }
watch_8 = Watch(loadFamily.familyTypes)
code_block_16 = CodeBlock { "Sofistik Section"; }
getParameterValueByName = Element.GetParameterValueByName(element=watch_8, parameterName=code_block_16)
code_block_17 = CodeBlock(a=getParameterValueByName) { "$prog aqua\nHEAD Section\n"+a; }
writeText = FileSystem.WriteText(filePath=code_block_15, text=code_block_17)
structural_points = CodeBlock(indices=removeItems) { ".\\structuralpointsgroup.dat"; prog = "sofimshc"; header = ["SPTP","REF","GRP"]; body = [indices + 1001, "1"]; }
writeDataToFile = Custom[DAT.WriteDataToFile](filepath=structural_points.out0, program=structural_points.prog, header=structural_points.header, body=structural_points.body)  # Given a header and a body as a list this node will generate a DAT Sofistik File
structural_lines = CodeBlock(indices=indices.out1, start=indices.out2, end=indices.out3, section=indices.out4)
# ---------- structural_lines.designscript (4 lines) ----------
".\\structurallines.dat";
prog = "sofimshc";
header = ["SLN", "NO", "NPA", "NPE", "SNO"];
body = [indices, start, end, section];
# ----------------------------------------
writeDataToFile_2 = Custom[DAT.WriteDataToFile](filepath=structural_lines.out0, program=structural_lines.prog, header=structural_lines.header, body=structural_lines.body)
getItemAtIndex = List.GetItemAtIndex(list=divideSegments.points, index=removeItems)
X = Point.X(point=getItemAtIndex)
structural_points_2 = CodeBlock(indices=removeItems, x=X)
# ---------- structural_points_2.designscript (4 lines) ----------
".\\structuralpoints.dat";
prog = "sofimshc";
header = ["SPT","NO","X","REF","NREF"];
body = [indices + 1001, x, "AX","A1"];
# ----------------------------------------
writeDataToFile_3 = Custom[DAT.WriteDataToFile](filepath=structural_points_2.out0, program=structural_points_2.prog, header=structural_points_2.header, body=structural_points_2.body)
# note: Returns all the necessary DAT that represents the deck (except the main).
# Remember to #inlcude the resulting DAT files in the main.
# Sofistik is ready to run =)
code_block_18 = CodeBlock { "Lane_Width"; }
getParameterValueByName_2 = Element.GetParameterValueByName(element=watch_8, parameterName=code_block_18)
# note: "offsets" is only used if more than one lane
# Otherwise: use "[];"
code_block_19 = CodeBlock(right=getParameterValueByName_2, left=getParameterValueByName_2) { [right,-left]; []; }
writeAxisToFile = Custom[DAT.WriteAxisToFile](points=transform, stations=divideSegments.stations, placementIndices=indicesOfItems, offsets=code_block_19.out1)  # writes points from spline to SOFiSTiK Axis

code_block_20 = CodeBlock { ".\\master_file.dat"; }

# group: MASTER FILE
code_block_21 = CodeBlock(Q_load_case=watch_7, mesh_size=watch_6)
# ---------- code_block_21.designscript (204 lines) ----------
"
$:.:.:.:.:.:.:.:.:.:.:.:.:.:.:.:.:.:.:.:.:.:.:.:.:.:.:$
$:.:.: SOFiSTiK MODEL W/ TEEDY - DOPPEL-T BRÜCKE :.:.:$
$:.:.:.:.:.:.:.:.:.:.:.:.:.:.:.:.:.:.:.:.:.:.:.:.:.:.:$

#DEFiNE Q_LOAD = "+Q_load_case+" $:.:UDL LiVE LOAD [KN/M]:.:.:.:.:.:.:.:.:.:.:.:.:$
                       $:.:GLOBAL VARiABLE, ACESSiBLE FROM ANY MODULE:.:$

+PROG AQUA URS:1
HEAD T_CROSS_SECTION, END BEAMS, SUPPORT BEAM, COLUMN
NORM EN 1992-2004
UNIT 0
CTRL STYP 0
STEE 1 S 275


$ VARiABLES
#include parameters.dat


$ GENERAL SECTiON
#include section.dat

END


+PROG SOFiMSHC URS:2
HEAD DEFiNiTiON OF AXiS
SYST 3D GDIV 1000 GDIR POSZ
ECHO GEOM FULL
CTRL TOPO GAXP 3 $ GENERATE STRUCTURAL POiNTS & LiNES ALONG PLACEMENTS
CTRL MESH "+mesh_size+"     $ ACTiVATE MESHiNG OF STRUCTRUAL SYSTEM iNTO BEAM ELEMENTS
CTRL HMiN "+mesh_size+"    	$ MESH SiZE: MAXiMUM LENGTH OF BEAM ELEMENTS

$ DEFiNiTiON OF AXiS iN PLAN ViEW <<< WE NEED TO PROViDE STATiONS__________________________________________
#include axis.dat

$ Structural Grid (Strucutal points)
#include structuralpoints.dat
#include structuralpointsgroup.dat

$ Structual lines (only for double transversal cross sections)


$ POiNTS AND LiNES AT 1ST SUPPORT
$ START BEAM RiGHT SUPPORT
SPT 1100 REF PT 100 X 0 =#Lane_Width-.3 =#Parapet_Thickness+#Beam_Height+#Slab_Thickness FIX F->100
        $RiGHT SPRiNG STiFFNESS
        SPTS TYPE CXX CP 1.E+6 GRP 2
        SPTS TYPE CYY CP 1.E+6 GRP 2
        SPTS TYPE CZZ CP 1.E+6 GRP 2
$ START BEAM LEFT SUPPORT
SPT 2100 REF PT 100 X 0 =-#Lane_Width+.3 =#Parapet_Thickness+#Beam_Height+#Slab_Thickness FIX F->100
        $LEFT SPRiNG STiFFNESS
        SPTS TYPE CZZ CP 1.E+6 GRP 2

$ POiNTS AND LiNES AT 3RD SUPPORT
$ END BEAM RiGHT SUPPORT
SPT 1300 REF PT 200 X 0 =#Lane_Width-.3 =#Parapet_Thickness+#Beam_Height+#Slab_Thickness FIX F->200
        $RiGHT SPRiNG STiFFNESS
        SPTS TYPE CXX CP 1.E+6 GRP 3
        SPTS TYPE CYY CP 1.E+6 GRP 3
        SPTS TYPE CZZ CP 1.E+6 GRP 3
$ END BEAM LEFT SUPPORT
SPT 2300 REF PT 200 X 0 =-#Lane_Width+.3 =#Parapet_Thickness+#Beam_Height+#Slab_Thickness FIX F->200
        $LEFT SPRiNG STiFFNESS
        SPTS TYPE CZZ CP 1.E+6 GRP 3

END


+PROG AQUA URS:4
HEAD iNTERPOLATiON OF SECTiONS ALONG AXiS
ECHO FULL 0
INTE 0
END

+PROG SOFiLOAD URS:6
HEAD ACTiONS + LOADS

$:.:DEFiNE ACTiONS:.:$
ACT G $:.:SELF WEiGTH:.:$
ACT Q $:.:iMPOSED LOADS:.:$

$ Definition of Load cases
$:.:SELF WEiGTH:.:$     ALL
LC 1 TYPE G DLZ 1

$:.:iMPOSED LOADS:.:$   1
LC 2 TYPE Q
BEAM grp 1  TYPE PZZ PA $(Q_LOAD)
END

+PROG ASE URS:5
HEAD CALCULATE
LC 1
LC 2
END

+PROG MAXiMA URS:7
HEAD SUPERPOSiTiON
ECHO CHCK

COMB 1 DESi
ACT G
ACT Q

SUPP 1 EXTR MAMi ETYP BEAM TYPE MY $:.:EVALUATiON OF THE MAXiMA AND MiNiMA BENDiNG MOMENT:.:$
SUPP 1 EXTR MAMi ETYP BEAM TYPE VZ
SUPP 1 EXTR MAMi ETYP BEAM TYPE N
END

+PROG DYNA URS:9
HEAD EiGEN FREQUENCiES
CTRL MCON 3 $:.:ENSURE TORSiONAL MASSES:.:$
EiGE 10 SiMU LC 10
END

+PROG RESULTS urs:3
HEAD Export results
$ Sheet 1 = weight per meter
XLSX NAME 'data.xlsx' WS 'W1' ROW 1 COL 1 CLNM YES
DBO  NAME 'beam_fcs.sign' ND    4
TXTP SHOW SIGN OVLP AMAX
STRU TYPE GAMM ETYP SECT REPR DLST
$ Sheet 2 = max stresses
XLSX NAME 'data.xlsx' WS 'S1' ROW 1 COL 1 CLNM YES
DBO  NAME 'beam_fcs.sign' ND    4
FILT NAME 'beam_fcs._pcstype' TYPE TEXT OPTI  YES VAL1 'Stressp*'
LC   NO 2
LC   ENO 1006 X 0
TXTP SHOW SIGN OVLP AMAX
CROS TYPE SIG ETYP BEAM RTYP LINE REPR DLST
$ Sheet 3 = max deflections
XLSX NAME 'data.xlsx' WS 'D1' ROW 1 COL 1 CLNM YES
FILT NAME 'n_disp.uz' TYPE EX
LC   NO 2
TXTP SHOW SIGN OVLP AMAX
NODE TYPE UZ REPR DLST
END

PROG WING
$ WinGraf document (version 20.02-70) from  6.03.20 , 17:00:31
HEAD $Cross sections
PAGE UNII 0 $ default unit set
CTRL OPT GSTR VAL DEFA
$ DB   NUMB 1 TITL 'sp-short.cdb'
CTRL OPT AXIS VAL DEFA
$ graphics    1 | picture    1 | layer    1 : Cross sections
PAGE LANO 1 UNIO 5
SIZE TYPE URS SC 0 SPLI '1*1'
SIZ2 SPLI DEFA
AND  POSI 1 POSL 0 POSR 100 POSD 0 POSU 100
SCHH H6 0.350000
LC   NO 2 DESI 1
BOX
VIEW TYPE DIRE X 0.864813 Y -0.422351 Z 0.271511 AXIS POSZ ROTA 0
DEFO TYPE FULL FAC DEFA LC CURR EXPO 0 SMOV NO
SELE NUMB 0
STRU NUME DSGN NUMN FULL
STRU NUME SSTR FILL NO REPR DSTR UNIT DEFA SCHH YES
$ graphics    1 | picture    1 | layer    2 : Nodal displacement vector  LC:          2
AND
SCHH H6 0.500000
SCH2 DIRE DEFA
GRID TYPE NO DIRE DEFA OFFP 0 OFFC 0 OFF3 0 TOLA 15 TOLZ -5
DEFO TYPE FULL FAC DEFA LC CURR EXPO 0 SMOV NO
SELE NUMB 0
NODE TYPE UV UNIT DEFA SCHH YES FILL NO REPR DTXT
$ graphics    2 | picture    1 | layer    1 : Beam Elements , Shear force Vz  LC:          2
SIZE TYPE URS SC 0 SPLI '2*1'
SIZ2
AND  POSI 1 POSL 0 POSR 100 POSD 50 POSU 100
SCHH H6 0.160000
SCH2 DIRE DEFA
VIEW TYPE DIRE X 0 Y -1 Z 0 AXIS POSZ ROTA 0
DEFO TYPE NO EXPO 0 SMOV NO
SELE NUMB 0
BEAM TYPE VZ UNIT DEFA SCHH YES STYP BEAM FILL NO REPR DLIN
$ graphics    2 | picture    2 | layer    1 : Beam Elements , Bending moment My  LC:          2
AND  POSI 2 POSL 0 POSR 100 POSD 0 POSU 50
SCH2 DIRE DEFA
BEAM TYPE MY UNIT DEFA SCHH YES STYP BEAM FILL NO REPR DLIN
$ graphics    3 | picture    1 | layer    1 : Spring force  LC:          2
SIZ2
AND  POSI 1 POSL 0 POSR 100 POSD 50 POSU 100
SCH2 DIRE DEFA
BEAM TYPE N UNIT DEFA SCHH YES STYP SPRI FILL NO REPR DLIN
$ graphics    3 | picture    2 | layer    1 : Nodal displacement in global Z  LC:          2
AND  POSI 2 POSL 0 POSR 100 POSD 0 POSU 50
SCH2 DIRE DEFA
FILL TYPE RGB FROM 0.178195 NUMB 5 MODE '' DMOD DDEF LIGH DEFA DARK 'A57'
FILL NUMB 40
NODE TYPE UZ UNIT DEFA SCHH YES FILL VERT REPR DEDG
$ graphics    3 | picture    2 | layer    2 : Supporting springs , Spring displacement  LC:          1
AND
FILL TYPE RGB NUMB 5 MODE '' DMOD DDEF LIGH DEFA DARK 'A57'
FILL NUMB 40
LC   NO 1
BEAM TYPE UX UNIT DEFA SCHH YES STYP SSPR FILL VERT REPR DLIN
$ Definitions of interactive work
iNTE SET 0 PAR1 2 PAR2 2 PAR3 1
END
";
# ----------------------------------------
writeText_2 = FileSystem.WriteText(filePath=code_block_20, text=code_block_21)

# group: UNITS IN METERS!
# note: Input dimensions in meters.
# This group automatically change Projects Units in Revit to meters.
boolean_2 = BoolSelector(true)
python_script = Python(IN[0]=boolean_2)
# ---------- python_script.python (22 lines) ----------
import clr

clr.AddReference('RevitAPI')
from Autodesk.Revit.DB import *

clr.AddReference('RevitServices')
import RevitServices
from RevitServices.Persistence import DocumentManager
from RevitServices.Transactions import TransactionManager

doc = DocumentManager.Instance.CurrentDBDocument

if IN[0]:
	TransactionManager.Instance.EnsureInTransaction(doc)
	unit = doc.GetUnits()
	format = FormatOptions(DisplayUnitType.DUT_METERS)
	unit.SetFormatOptions(UnitType.UT_Length,format)
	doc.SetUnits(unit)
	TransactionManager.Instance.TransactionTaskDone()
	OUT = "length unit changed to meter"
else:
	OUT = "Set IN[0] to true!"
# ----------------------------------------

# group: BATCH FILE CREATION
code_block_22 = CodeBlock { ".\\runSimpleAnalysis.bat"; }
# note: A batch file is created at the current folder.
# By executing this file, it runs Sofistik analysis, so there is no need to open it.
# note: The batch file retrieves the current directory, then calls Sofitik's solver and uses the master file as argument.
run_analysis_batch_file = CodeBlock(master_file=code_block_20) { "setlocal\ncd /d %~dp0\nstart \"\" /WAIT \"C:\\Program Files\\SOFiSTiK\\2020\\SOFiSTiK 2020\\sps.exe\" \""+master_file+"\" -b"; }
writeText_3 = FileSystem.WriteText(filePath=code_block_22, text=run_analysis_batch_file)
